# Grasshopper definition DataGeneration.gh (Grasshopper 0.9.76)
# plug-ins: Owl.GH

pop3d = Populate3D(Region={Plane=PlaneXY(0, 0, 0), X=Domain(0, 1), Y=Domain(0, 1), Z=Domain(0, 1)}, Count=Slider(100, range=0..100), Seed=1)
pdecon = Deconstruct(Point=pop3d)  # -> XComponent, YComponent, ZComponent
featurets = FeatureTensorSet(Feature0=pdecon.ZComponent)
featurets_2 = FeatureTensorSet(Feature0=pdecon.XComponent, Feature1=pdecon.YComponent)
toidx = SaveIDXTensorSet(TensorSet=featurets, SaveFile="C:/Users/Mateusz/Desktop/Random100_Outputs.idx", DataType="System.Single")
toidx_2 = SaveIDXTensorSet(TensorSet=featurets_2, SaveFile="C:/Users/Mateusz/Desktop/Random100_Inputs.idx", DataType="System.Single")
